# Dynamo graph Frame FORM v2.dyn (Dynamo 2.17.0.3472)

# group: GEOMETRY
lenghts = CodeBlock { [0,5,5,5]; }
code_block = CodeBlock(lst=lenghts) { Math.Sum(List.DropItems(lst, -List.Count(lst)+1..0)); }
level_heights = CodeBlock()
# ---------- level_heights.designscript (4 lines) ----------
[0,
4,
4,
4];
# ----------------------------------------
code_block_2 = CodeBlock(lst=level_heights) { Math.Sum(List.DropItems(lst, -List.Count(lst)+1..0)); }
byCoordinates = Point.ByCoordinates(x=code_block, z=code_block_2, lacing=CrossProduct)
transpose = List.Transpose(lists=byCoordinates)

# group: GEOMETRY > Columns
byPoints = PolyCurve.ByPoints(points=byCoordinates)
curves = PolyCurve.Curves(polyCurve=byPoints)

# group: GEOMETRY > Beams
byPoints_2 = PolyCurve.ByPoints(points=transpose)
code_block_3 = CodeBlock { 0; }
removeItemAtIndex = List.RemoveItemAtIndex(list=byPoints_2, indices=code_block_3)
curves_2 = PolyCurve.Curves(polyCurve=removeItemAtIndex)

# group (continued): GEOMETRY
list_create = List.Create(item0=curves, item1=curves_2)
flatten = List.Flatten(list=list_create)

# group: GEOMETRY INPUTS
support_list = CodeBlock { [1,5,9,13]; }
point_load_nodes = CodeBlock()  # unwired: FX
# ---------- point_load_nodes.designscript (3 lines) ----------
[2,3,4];
FX;
 //direction;
# ----------------------------------------
dist_load_members = CodeBlock { [13,14,15,16,17,18,19,20,21]; }

# group: MATERIAL INPUTS
e_mean = CodeBlock()
# ---------- e_mean.designscript (2 lines) ----------
//(kN/m2) Modulus of elasticity
200000000;
# ----------------------------------------
rho = CodeBlock()
# ---------- rho.designscript (2 lines) ----------
//(kN/m3) Density
76.97;
# ----------------------------------------

# group: BOUNDARY INPUTS
displacement_limit = CodeBlock()
# ---------- displacement_limit.designscript (2 lines) ----------
//cm
0.01;
# ----------------------------------------
allowable_reliability_indices = CodeBlock { [3.0, 3.0, 3.0]; }
mean_loads = CodeBlock()
# ---------- mean_loads.designscript (8 lines) ----------
mean_P1 = 133.33;
  // Point Loads (kN);
mean_P2 = 266.67;
  //Point Loads (kN);
mean_P3 = 400;
  //Point Loads (kN);
mean_Wd = 20;
  // Dist. load (kN/m);
# ----------------------------------------
V = CodeBlock()  # "C.O.V"
# ---------- V.designscript (6 lines) ----------
cov_P = 0.10;
  //# C.O.V. for P1, P2, P3;
cov_E= 0.05;
  //# C.O.V. for E;
cov_Wd = 0.10;
    //# C.O.V. for Wd;
# ----------------------------------------
code_block_4 = CodeBlock { "Fixed"; }

# group: OPTIMIZATION INPUTS
population_size = CodeBlock { 2; }
number_of_gen = CodeBlock { 10; }
column_sections = CodeBlock()
# ---------- column_sections.designscript (8 lines) ----------
[
        "W 14x730", "W 14x426", "W 14x257", "W 14x145", "W 14x82", "W 14x43",
        "W 14x665", "W 14x398", "W 14x233", "W 14x132", "W 14x74", "W 14x38",
        "W 14x605", "W 14x370", "W 14x211", "W 14x120", "W 14x68", "W 14x34",
        "W 14x550", "W 14x342", "W 14x193", "W 14x109", "W 14x61", "W 14x30",
        "W 14x500", "W 14x311", "W 14x176", "W 14x99", "W 14x53", "W 14x26",
        "W 14x455", "W 14x283", "W 14x159", "W 14x90", "W 14x48", "W 14x22"
];
# ----------------------------------------
beam_sections = CodeBlock()
# ---------- beam_sections.designscript (8 lines) ----------
[
        "W 21x201", "W 21x111", "W 21x62",
        "W 21x182", "W 21x101", "W 21x57",
        "W 21x166", "W 21x93", "W 21x55",
        "W 21x147", "W 21x83", "W 21x50",
        "W 21x132", "W 21x73",
        "W 21x122", "W 21x68"
 ];
# ----------------------------------------
create_and_analyse_structure_on = BoolSelector(true)  # "Create and Analyse Structure on RSA"

# group: RESULTS
fem_form_de = Python(IN[0]=flatten, IN[1]=support_list, IN[2]=point_load_nodes.out0, IN[3]=dist_load_members, IN[4]=e_mean, IN[5]=rho, IN[6]=displacement_limit, IN[7]=allowable_reliability_indices, IN[8]=mean_loads.mean_P1, IN[9]=mean_loads.mean_P2, IN[10]=mean_loads.mean_P3, IN[11]=mean_loads.mean_Wd, IN[12]=V.cov_P, IN[13]=V.cov_Wd, IN[14]=V.cov_Wd, IN[15]=population_size, IN[16]=number_of_gen, IN[17]=column_sections, IN[18]=beam_sections)  # CPython3
# ---------- fem_form_de.python (615 lines) ----------
import sys
import clr
clr.AddReference('ProtoGeometry')
from Autodesk.DesignScript.Geometry import *
from io import StringIO
sys.stdout = StringIO()
import os

supports= IN[1]



# Adding the site-packages directory to sys.path
localapp = os.getenv('LOCALAPPDATA')
site_packages_path = os.path.join(localapp, 'python-3.9.12-embed-amd64', 'Lib', 'site-packages')
sys.path.append(site_packages_path)

from pymoo.core.problem import Problem
from pymoo.operators.sampling.rnd import IntegerRandomSampling
from pymoo.optimize import minimize
from pymoo.config import Config
from pymoo.algorithms.soo.nonconvex.de import DE
from pymoo.optimize import minimize
import pystra as ps
import numpy as np
import time
from PyNite import FEModel3D,Visualization
import pandas as pd

start_time = time.time()



def round_coords(x, y, z, precision=4):
    return (round(x, precision), round(y, precision), round(z, precision))

def excel_call(list_of_numbers):

    column_sections = IN[17]

    beam_sections = IN[18]


    # Load the Excel file outside the loop to avoid repeated loading
    file_path = r'C:\Users\ugury\OneDrive\Masaüstü\Programming\FORM Pynite\Frame\section_properties.xlsx'
    df = pd.read_excel(file_path)

    # Lists to hold results for all sets of numbers
    all_Iy_lists, all_Iz_lists, all_A_lists, all_J_lists, all_V_lists = [], [], [], [], []


    for numbers in list_of_numbers:
        colum_indexes = numbers[:4]

        beams_indexes = numbers[4:]


        selected_columns = [column_sections[i] for i in colum_indexes]
        selected_beams = [beam_sections[i] for i in beams_indexes]
        section_list = selected_columns + selected_beams

        sections = section_list

        Iy_list, Iz_list, A_list, J_list, V_list = [], [], [], [], []

        for section in sections:
            Iy = df.loc[df['Section Name'] == section, "Iy[cm4]"].values[0] if section in df['Section Name'].values else None
            Iz = df.loc[df['Section Name'] == section, "Iz[cm4]"].values[0] if section in df['Section Name'].values else None
            A = df.loc[df['Section Name'] == section, "A[cm2]"].values[0] if section in df['Section Name'].values else None
            J = df.loc[df['Section Name'] == section, "Ip[cm4]"].values[0] if section in df['Section Name'].values else None
            V = df.loc[df['Section Name'] == section, "V[cm3/m]"].values[0] if section in df['Section Name'].values else None

            Iy_list.append(Iy)
            Iz_list.append(Iz)
            A_list.append(A)
            J_list.append(J)
            V_list.append(V)

        # Convert units
        Iy_list = [x * 1.0E-8 for x in Iy_list if x is not None]
        Iz_list = [x * 1.0E-8 for x in Iz_list if x is not None]
        A_list = [x * 1.0E-4 for x in A_list if x is not None]
        J_list = [x * 1.0E-8 for x in J_list if x is not None]
        V_list = [x * 1.0E-6 for x in V_list if x is not None]

        # Append the lists of results to the corresponding overall lists
        all_Iy_lists.append(Iy_list)
        all_Iz_lists.append(Iz_list)
        all_A_lists.append(A_list)
        all_J_lists.append(J_list)
        all_V_lists.append(V_list)

    return all_Iy_lists, all_Iz_lists, all_A_lists, all_J_lists, all_V_lists

def volume_func(mean_V):


    bars = IN[0]

    
    # Create a new finite element model
    model = FEModel3D.FEModel3D()
    
    # Dictionary to map unique nodes to their assigned IDs
    unique_nodes = {}
    next_node_id = 1  # Start with the first ID for nodes
    next_member_id = 1  # Start with the first ID for members

    members = []  # This will hold the list of members as tuples
    
    # Assign an ID to each unique node and prepare to create members
    for bar in bars:
        start_key = round_coords(bar.StartPoint.X, bar.StartPoint.Z, bar.StartPoint.Y)
        end_key = round_coords(bar.EndPoint.X, bar.EndPoint.Z, bar.EndPoint.Y)
    
        # Check and add the start node if unique
        if start_key not in unique_nodes:
            unique_nodes[start_key] = next_node_id
            model.add_node(str(next_node_id), *start_key)
            next_node_id += 1
    
        # Check and add the end node if unique
        if end_key not in unique_nodes:
            unique_nodes[end_key] = next_node_id
            model.add_node(str(next_node_id), *end_key)
            next_node_id += 1
            
        
        # Create a member between start and end nodes
        start_node_id = unique_nodes[start_key]
        end_node_id = unique_nodes[end_key]
        member_id = f"M{next_member_id}"
        members.append((member_id, str(start_node_id), str(end_node_id)))
        next_member_id += 1


    # Define material (name, elastic modulus, poissons ratio, density)
    E_current = IN[4] # (kN/m2) Modulus of elasticity
    G = 76904120  # (kN/m2) Shear modulus
    nu = 0.3  # Poisson's ratio
    rho = 76.97  # (kN/m3) Density
    model.add_material('Steel', E_current, G, nu, rho)


    V_list = mean_V
    V_list = [V_list[0]] * 2 + [V_list[1]] + [V_list[2]] * 2 + [V_list[3]] + [V_list[2]] * 2 + [V_list[3]] + [V_list[0]] * 2 + [V_list[1]] + [V_list[4]] * 6 + [V_list[5]] * 3





    # Create the model and add members with their respective properties
    for i, member in enumerate(members):
        name, node_i, node_j = member
        model.add_member(name, node_i, node_j,'Steel')


    # Calculate and print the volume of the structure
    total_volume = 0.0
    for i, member_name in enumerate(model.Members):
        V = V_list[i]
        L = model.Members[member_name].L()
        volume = V * L 
        total_volume += volume


    return total_volume
    
    

def myfunction(P1,P2,P3, E,Wd, X0,X1,X2,X3,X4,X5,I0,I1,I2,I3,I4,I5, mean_Iy, mean_Ij):

    displacement_list = []
    for k in range(len(E)):

        # INPUTS

        bars = IN[0]
        
        # Create a new finite element model
        model = FEModel3D.FEModel3D()
        
        # Dictionary to map unique nodes to their assigned IDs
        unique_nodes = {}
        next_node_id = 1  # Start with the first ID for nodes
        next_member_id = 1  # Start with the first ID for members
    
        members = []  # This will hold the list of members as tuples
        
        # Assign an ID to each unique node and prepare to create members
        for bar in bars:
            start_key = round_coords(bar.StartPoint.X, bar.StartPoint.Z, bar.StartPoint.Y)
            end_key = round_coords(bar.EndPoint.X, bar.EndPoint.Z, bar.EndPoint.Y)
        
            # Check and add the start node if unique
            if start_key not in unique_nodes:
                unique_nodes[start_key] = next_node_id
                model.add_node(str(next_node_id), *start_key)
                next_node_id += 1
        
            # Check and add the end node if unique
            if end_key not in unique_nodes:
                unique_nodes[end_key] = next_node_id
                model.add_node(str(next_node_id), *end_key)
                next_node_id += 1
            
            # Create a member between start and end nodes
            start_node_id = unique_nodes[start_key]
            end_node_id = unique_nodes[end_key]
            member_id = f"M{next_member_id}"
            members.append((member_id, str(start_node_id), str(end_node_id)))
            next_member_id += 1

        # Define supports (node, x_restraint, y_restraint, z_restraint, x_rotation_restraint, y_rotation_restraint, z_rotation_restraint)
        for element in supports:
        
            model.def_support(f'{element}', True, True, True, True, True, True)


        # Define material (name, elastic modulus, poissons ratio, density)
        E_current = E[k]  # (kN/m2) Modulus of elasticity
        G = 76904120  # (kN/m2) Shear modulus
        nu = 0.3  # Poisson's ratio
        rho = IN[5]  # (kN/m3) Density
        model.add_material('Steel', E_current, G, nu, rho)

        Iy_list = mean_Iy   
        J_list = mean_Ij  

        A_list=[X0[k],X1[k],X2[k],X3[k],X4[k],X5[k]]
        Iz_list=[I0[k],I1[k],I2[k],I3[k],I4[k],I5[k]]


        # Define separate lists for Iy, Iz, and A
        # Adjust the lists according to the pattern in section_names
        J_list = [J_list[0]] * 2 + [J_list[1]] + [J_list[2]] * 2 + [J_list[3]] + [J_list[2]] * 2 + [J_list[3]] + [J_list[0]] * 2 + [J_list[1]] + [J_list[4]] * 6 + [J_list[5]] * 3
        Iy_list = [Iy_list[0]] * 2 + [Iy_list[1]] + [Iy_list[2]] * 2 + [Iy_list[3]] + [Iy_list[2]] * 2 + [Iy_list[3]] + [Iy_list[0]] * 2 + [Iy_list[1]] + [Iy_list[4]] * 6 + [Iy_list[5]] * 3
        Iz_list = [Iz_list[0]] * 2 + [Iz_list[1]] + [Iz_list[2]] * 2 + [Iz_list[3]] + [Iz_list[2]] * 2 + [Iz_list[3]] + [Iz_list[0]] * 2 + [Iz_list[1]] + [Iz_list[4]] * 6 + [Iz_list[5]] * 3
        A_list = [A_list[0]] * 2 + [A_list[1]] + [A_list[2]] * 2 + [A_list[3]] + [A_list[2]] * 2 + [A_list[3]] + [A_list[0]] * 2 + [A_list[1]] + [A_list[4]] * 6 + [A_list[5]] * 3


 




        # Create the model and add members with their respective properties
        for i, member in enumerate(members):
            name, node_i, node_j = member
            Iy = Iz_list[i] # bcs of different coordinate system
            Iz = Iy_list[i] # bcs of different coordinate system
            A = A_list[i]
            J = J_list[i]

            model.add_member(name, node_i, node_j, 'Steel', Iy, Iz,J,A)

        
        Loads=IN[2]
        # Add loads (kN)
        model.add_node_load(f'{Loads[0]}', 'FX', P1[k]) 
        model.add_node_load(f'{Loads[1]}', 'FX',P2[k])
        model.add_node_load(f'{Loads[2]}', 'FX',P3[k])

        WD=Wd[k]
        
        Dist_Loads=IN[3]
        # (kN/m)
        
        for element in Dist_Loads:
            model.add_member_dist_load(f'M{element}', 'FY', -WD, -WD)
        



        # Analyze the model
        model.analyze(check_statics=False, check_stability=True)




        # Step 1: Initialize a dictionary to store displacements for each level
        story_displacements = {}

        # Step 2: Loop through all nodes to group nodes by their Y-coordinate (level height)
        for node_id in model.Nodes:
            node = model.Nodes[node_id]
            y = node.Y  # Y-coordinate of the node (used to identify the level)
            
            # Initialize displacement list for the story if it doesn't exist yet
            if y not in story_displacements:
                story_displacements[y] = {'dx': [], 'dy': [], 'dz': []}
            
            # Step 3: Retrieve displacements for each node
            dx = node.DX['Combo 1']  # Displacement in X direction

            
            # Step 4: Append the displacements to the corresponding story (Y-level)
            story_displacements[y]['dx'].append(dx)
            


        max_story_displacements=[]

        # Step 5: Now you have displacement lists for each story (Y level)
        for level, displacements in story_displacements.items():
            max_dx = max(displacements['dx'], default=0)
            max_story_displacements.append(max_dx)



        displacement_list.append(max_story_displacements[1:])

        #Visualization.render_model(model, annotation_size=0.5, deformed_shape=False, deformed_scale=1)

    return displacement_list
    




#region FORM SECTION
def FORM(mean_A_list, mean_Iz_list, mean_Iy_list, mean_J_list):   

    disp_lim=IN[6]
    beta_allowable = IN[7] # Allowable reliability indices for each floor

    def limit_state_function1(P1, P2, P3, E, Wd, X0, X1, X2, X3, X4, X5, I0, I1, I2, I3, I4, I5):

        # Directly use mean_Iy_list, mean_J_list, mean_V_list from the enclosing scope
        func_result = myfunction(P1, P2, P3, E, Wd, X0, X1, X2, X3, X4, X5, I0, I1, I2, I3, I4, I5,mean_Iy_list,mean_J_list)
        # print("func_result", func_result)


        displacements = func_result

        # Define lists for each floor's displacements
        first_floor_displacements = []
        second_floor_displacements = []
        third_floor_displacements = []

        # Iterate through the displacement sublists and extract displacements for each floor
        for displacement in displacements:
            first_floor_displacements.append(displacement[0])
            second_floor_displacements.append(displacement[1])
            third_floor_displacements.append(displacement[2])

        Displacement = np.array(first_floor_displacements)

        # Return all constraints in an array
        return disp_lim - abs(Displacement)
    
    def limit_state_function2(P1, P2, P3, E, Wd, X0, X1, X2, X3, X4, X5, I0, I1, I2, I3, I4, I5):

        # Directly use mean_Iy_list, mean_J_list, mean_V_list from the enclosing scope
        func_result = myfunction(P1, P2, P3, E, Wd, X0, X1, X2, X3, X4, X5, I0, I1, I2, I3, I4, I5,mean_Iy_list,mean_J_list)



        displacements = func_result

        # Define lists for each floor's displacements
        first_floor_displacements = []
        second_floor_displacements = []
        third_floor_displacements = []

        # Iterate through the displacement sublists and extract displacements for each floor
        for displacement in displacements:
            first_floor_displacements.append(displacement[0])
            second_floor_displacements.append(displacement[1])
            third_floor_displacements.append(displacement[2])


        # Return all constraints in an array
        return disp_lim - abs(np.array(second_floor_displacements)-np.array(first_floor_displacements))
    def limit_state_function3(P1, P2, P3, E, Wd, X0, X1, X2, X3, X4, X5, I0, I1, I2, I3, I4, I5):

        # Directly use mean_Iy_list, mean_J_list, mean_V_list from the enclosing scope
        func_result = myfunction(P1, P2, P3, E, Wd, X0, X1, X2, X3, X4, X5, I0, I1, I2, I3, I4, I5,mean_Iy_list,mean_J_list)



        displacements = func_result

        # Define lists for each floor's displacements
        first_floor_displacements = []
        second_floor_displacements = []
        third_floor_displacements = []

        # Iterate through the displacement sublists and extract displacements for each floor
        for displacement in displacements:
            first_floor_displacements.append(displacement[0])
            second_floor_displacements.append(displacement[1])
            third_floor_displacements.append(displacement[2])

        # Return all constraints in an array
        return disp_lim - abs(np.array(third_floor_displacements)-np.array(second_floor_displacements))
    

    limit_state1= ps.LimitState(limit_state_function1)
    limit_state2= ps.LimitState(limit_state_function2)
    limit_state3= ps.LimitState(limit_state_function3)
    # print("limit_state", limit_state)



    # Create a model
    model = ps.StochasticModel()
    
    # Define the random variables
    covs = [0.05] * len(mean_A_list)

    stdvs_A = [mean * cov for mean, cov in zip(mean_A_list, covs)]
    stdvs_I = [mean * cov for mean, cov in zip(mean_Iz_list, covs)] 

    for i, (mean, stdv) in enumerate(zip(mean_A_list, stdvs_A)):
        model.addVariable(ps.Lognormal(f'X{i}', mean=mean, stdv=stdv))

    for i, (mean, stdv) in enumerate(zip(mean_Iz_list, stdvs_I)):
        model.addVariable(ps.Lognormal(f'I{i}', mean=mean, stdv=stdv))        

    # Define mean values for each variable
    mean_P1 = IN[8] # Loads (kN)
    mean_P2 = IN[9]  # Loads (kN)
    mean_P3 = IN[10]  # Loads (kN)
    mean_Wd = IN[11]  # Wind load (kN/m)
    mean_E = IN[4]# Modulus of elasticity in kN/m²

    # Define Coefficients of Variation (C.O.V.)
    cov_P =  IN[12]  # C.O.V. for P1, P2, P3
    cov_E_Wd =  IN[13]  # C.O.V. for E
    cov_Wd =  IN[14]    # C.O.V. for Wd

    # Calculate standard deviations based on mean and C.O.V.
    stdv_P1 = cov_P * mean_P1
    stdv_P2 = cov_P * mean_P2
    stdv_P3 = cov_P * mean_P3
    stdv_Wd = cov_Wd * mean_Wd
    stdv_E = cov_E_Wd * mean_E

    # Update model variable definitions using these variables
    model.addVariable(ps.Lognormal('P1', mean=mean_P1, stdv=stdv_P1))  # Loads (kN)
    model.addVariable(ps.Lognormal('P2', mean=mean_P2, stdv=stdv_P2))  # Loads (kN)
    model.addVariable(ps.Lognormal('P3', mean=mean_P3, stdv=stdv_P3))  # Loads (kN)
    model.addVariable(ps.Normal('Wd', mean=mean_Wd, stdv=stdv_Wd))     # Wind load (kN/m)
    model.addVariable(ps.Lognormal('E', mean=mean_E, stdv=stdv_E))     # Modulus of elasticity (kN/m²)
  
    # Perform reliability analysis using FORM
    analysis = ps.AnalysisOptions()
    analysis.setPrintOutput(False)
    analysis.setStepSize(1)    
    Analysis1 = ps.Form(
        analysis_options=analysis,
        stochastic_model=model,
        limit_state=limit_state1,
    )
    Analysis1.run() # run analysis
    
    # Some single results:
    beta1 = Analysis1.getBeta()
    # Perform reliability analysis using FORM

 
    Analysis2 = ps.Form(
        analysis_options=analysis,
        stochastic_model=model,
        limit_state=limit_state2,
    )
    Analysis2.run() # run analysis
    
    # Some single results:
    beta2 = Analysis2.getBeta()

        # Perform reliability analysis using FORM
  
    Analysis3 = ps.Form(
        analysis_options=analysis,
        stochastic_model=model,
        limit_state=limit_state3,
    )
    Analysis3.run() # run analysis
    
    # Some single results:
    beta3 = Analysis3.getBeta()
    # Analysis1.showDetailedOutput()
    # Analysis2.showDetailedOutput()
    # Analysis3.showDetailedOutput()

    betas = [beta1, beta2, beta3]
  
    violance = np.zeros_like(betas)  #
    
    
    for i, beta in enumerate(betas): violance[i] = (beta_allowable[i]-beta  ) / beta_allowable[i]
    

    return violance
#endregion    




pop_size=IN[15]
n_gen=IN[16]



#region Optimization Problem section    
class Problem(Problem):
    def __init__(self):
        super().__init__(n_var=6, 
                         n_obj=1,
                         n_ieq_constr=3, n_eq_constr=0,
                         xl=np.array([0]*6),  
                         xu=np.array([35,35,35,35,15,15]),
                         vtype=int
                        )
            

    def _evaluate(self, x, out, *args, **kwargs):
        
        x=x.tolist() 

        x=[[int(i) for i in sublist] for sublist in x]
        Iy_list, Iz_list, A_list, J_list, V_list = excel_call(x)

        strc_volume=[volume_func(sublist) for sublist in V_list] 

        violance_list = [FORM(sublist_A, sublist_Iz, sublist_Iy,sublist_J) for sublist_A, sublist_Iz, sublist_Iy,sublist_J in zip(A_list, Iz_list, Iy_list, J_list)]

        # Convert violance_list to an array and handle constraints separately
        violance_array = np.array(violance_list).reshape(-1, 3)  # Separate penalties for each constraint

        out["F"] = np.column_stack(strc_volume)
        out["G"] = violance_array


problem = Problem()

# algorithm =  NSGA2(pop_size=30,
#                     sampling=IntegerRandomSampling(),
#                     crossover=SBX(prob=1.0, eta=3.0, vtype=float,repair=RoundingRepair()),
#                     mutation=PM(prob=1.0, eta=3.0, vtype=float,repair=RoundingRepair()),
#                     eliminate_duplicates=True)
# algorithm = GA(pop_size=20,
#                sampling=FloatRandomSampling(),
#                crossover=SBX(prob=1.0, eta=3.0, vtype=float),
#                mutation=PM(prob=1.0, eta=3.0, vtype=float),
#                eliminate_duplicates=True)
from pymoo.constraints.eps import AdaptiveEpsilonConstraintHandling
algorithm = AdaptiveEpsilonConstraintHandling( DE(
    pop_size=pop_size,
    sampling=IntegerRandomSampling(),
    variant="DE/rand/1/bin",
    CR=0.3,
    dither="vector",
    jitter=False
),perc_eps_until=0.25)


res = minimize(problem, algorithm,('n_gen', n_gen),verbose=True)

print("Best solution found:")
print("Variables:", res.X)
print("CV", res.G)

print("Weight", res.F)

print("Execution time: {:.2f} seconds".format(time.time() - start_time))    
# plot(res.F, )
    
    

# X1 = np.array([10000, 1001, 10002])
# X2 = np.array([0.1, 0.1, 0.11])
# X3 = 10
# E=np.array([10000, 1001, 10002])
# x=[33.5, 1.62, 22,15.5,1.62,1.8,14.2,19.9,19.9,2.62]
# weight_score = myfunction(X1, X2,E,x)
# print("Weight Score:", weight_score)
 
# result=np.array(weight_score)
# print(result)


#endregion
"""

P1= [133.33    , 133.33    , 133.3    ]
P2 =[266.67     ,266.67    , 266.67   ]
P3= [  400.00, 400.,   400.  ]
E= [ 199947970 , 2.0000e+08, 2.0001e+08]
Wd= [ 20.,    20.002, 20.   ]
X0= [0.022774000000000003,   0.02754938, 0.027548  ]
X1= [0.020645,   0.006452,   0.00645232   ]
X2= [0.053742,   0.018774,   0.018774   ]
X3 =[0.033419000000000004,     0.04,     0.04  ]
X4= [0.031484,   0.015742,   0.015742  ]
X5 =[0.013871000000000001,   0.011806,   0.011806 ]
I0= [0.0002060346, 0.00028179, 0.00028179 ]
I1= [0.00018605540000000002, 9.69820000e-06, 9.69820000e-06]
I2= [0.0005993733, 0.00016733, 0.00016733 ]
I3= [0.0003488019, 0.00042872, 0.00042872 ]
I4= [0.0001810607, 3.38812000e-05, 3.38812000e-05 ]
I5 =[2.9385900000000003e-05, 2.39333000e-05, 2.39333000e-05 ]
Iy_list= [0.0005743994, 0.000516127, 0.0015983287, 0.0008907353, 0.0017814705, 0.0006659703]
Iz_list= [0.0002060346, 0.00018605540000000002, 0.0005993733, 0.0003488019, 0.0001810607, 2.9385900000000003e-05]
J_list= [0.0007804339000000001, 0.0007021824000000001, 0.0021977019, 0.0012395372, 0.0019625312, 0.0006953562]
# Call the function
x=myfunction(P1, P2, P3, E, Wd, X0, X1, X2, X3, X4, X5, I0, I1, I2, I3, I4, I5,Iy_list,J_list)
print("x", x)
  
"""  
sys.stdout.seek(0)
OUT = sys.stdout.read(), res.X
   
# ----------------------------------------
watch = Watch(fem_form_de)
generate_and_analyse_on_rsa = Python(IN[0]=watch, IN[1]=create_and_analyse_structure_on, IN[2]=flatten, IN[3]=support_list, IN[4]=mean_loads.mean_P1, IN[5]=column_sections, IN[6]=beam_sections, IN[7]=code_block_4, IN[8]=point_load_nodes.out0, IN[9]=point_load_nodes.FX, IN[10]=e_mean, IN[11]=rho, IN[12]=mean_loads.mean_P2, IN[13]=mean_loads.mean_P3, IN[14]=mean_loads.mean_Wd)  # CPython3
# ---------- generate_and_analyse_on_rsa.python (229 lines) ----------
import clr  # Required for Python for .NET
import sys
import random
import sys
from io import StringIO
sys.stdout = StringIO()
clr.AddReference('ProtoGeometry')
from Autodesk.DesignScript.Geometry import *

import time
start_time = time.time()

# INPUTS

option=IN[1]
sections=IN[0][1]
bars=IN[2]

if option == True:
    
    
    print("Structure Created on RSA and Analysis have been started")

    
    # Load the RSA API library
    clr.AddReference(r'D:\Programs\Autodesk\RSA25\Robot Structural Analysis Professional 2025\Exe\Interop.RobotOM.dll')
    
    # Import the RSA API
    from RobotOM import *
    from System import Object
    
    RobApp= RobotApplicationClass()
    
  ## Dictionary to map unique nodes to their assigned IDs
    unique_nodes = {}
    next_node_id = 1  # Start with the first ID for nodes
    next_bar_id = 1  # Start with the first ID for bars
    
    def round_coords(x, y, z, precision=4):
        return (round(x, precision), round(y, precision), round(z, precision))
    
    # Assign an ID to each unique node
    for bar in bars:
        start_key = round_coords(bar.StartPoint.X, bar.StartPoint.Y, bar.StartPoint.Z)
        end_key = round_coords(bar.EndPoint.X, bar.EndPoint.Y, bar.EndPoint.Z)
    
        # If the start node is unique, assign an ID
        if start_key not in unique_nodes:
            unique_nodes[start_key] = next_node_id
            next_node_id += 1
    
        # If the end node is unique, assign an ID
        if end_key not in unique_nodes:
            unique_nodes[end_key] = next_node_id
            next_node_id += 1
    
    # Now create nodes and bars in RSA
    for bar in bars:
        start_key = round_coords(bar.StartPoint.X, bar.StartPoint.Y, bar.StartPoint.Z)
        end_key = round_coords(bar.EndPoint.X, bar.EndPoint.Y, bar.EndPoint.Z)
    
        # Retrieve the pre-assigned node IDs
        start_node_id = unique_nodes[start_key]
        end_node_id = unique_nodes[end_key]
    

        # Create the nodes with the assigned IDs
        RobApp.Project.Structure.Nodes.Create(start_node_id, *start_key)
        RobApp.Project.Structure.Nodes.Create(end_node_id, *end_key)
    
        # Create the bar between the nodes
        RobApp.Project.Structure.Bars.Create(next_bar_id, start_node_id, end_node_id)
        next_bar_id += 1  # Increment the bar ID for the next creation

    
    support_list = IN[3]
    support_type= IN[7]
    FZ= [IN[4],IN[12],IN[13]]

    num_list = IN[8]

    result = " ".join(map(str, num_list))
    direction= IN[9]
    selfw = "1to" + str(next_bar_id-1)
    dist_load=IN[14]
    beam_list = [13,14,15,16,17,18,19,20,21]
    
    for i in support_list:
    
        set_node1 = RobApp.Project.Structure.Nodes.Get(i)
        support1= IRobotNode(set_node1)
        support1.SetLabel(IRobotLabelType.I_LT_SUPPORT, support_type)
    
   
   
    
    
    # Create a new simple case
    case_number = RobApp.Project.Structure.Cases.FreeNumber
    cas = RobApp.Project.Structure.Cases.CreateSimple(case_number,"Case_1", IRobotCaseNature.I_CN_PERMANENT , IRobotCaseAnalizeType.I_CAT_STATIC_LINEAR )
    
    cas2 = RobApp.Project.Structure.Cases.CreateSimple(case_number+1,"Case_2", IRobotCaseNature.I_CN_PERMANENT , IRobotCaseAnalizeType.I_CAT_STATIC_LINEAR )
    

    case2=cas2.Records.Create(IRobotLoadRecordType.I_LRT_DEAD)
            # Point weight
    # Apply multiple forces at different nodes
    for idx, force in enumerate(FZ):
        case1 = cas.Records.Create(IRobotLoadRecordType.I_LRT_NODE_FORCE)
        load_record = RobotLoadRecord(case1)
        load_record.SetValue(IRobotNodeForceRecordValues.I_NFRV_FX, force*1000)
        
        selection = load_record.get_Objects()
        sel = IRobotSelection(selection)
        sel.FromText(f"{num_list[idx]}")  # Apply each force to its corresponding node
        
     

    case1 = cas2.Records.Create(IRobotLoadRecordType.I_LRT_BAR_UNIFORM)
    load_record = RobotLoadRecord(case1)
    
    # Set the uniform load value in the required direction (assumed here to be Z-direction)
    load_record.SetValue(IRobotUniformRecordValues.I_URV_PZ, -1000*dist_load)
    
    # Apply to the corresponding beam (assuming beam_list contains the beam IDs)
    selection = load_record.get_Objects()
    sel = IRobotSelection(selection)
    sel.FromText("13to21")  # Apply each distributed load to its corresponding beam
        
        


    case22=RobotLoadRecord(case2)
    case22.SetValue(IRobotDeadRecordValues.I_DRV_Z,-1)
    selection2 = case22.get_Objects()
    b= IRobotSelection(selection2)
    b.FromText(selfw) 
    

   
   
       
    # Defining Material
    
    # Define the material name
    material_name = "FrameSteel"
    
    
    a=RobApp.Project.Structure.Labels
    a=IRobotLabelServer(a)
    
    a=a.Create(IRobotLabelType.I_LT_MATERIAL, material_name)
    
    material = IRobotLabel(a).Data
    
    
    material=IRobotMaterialData(material)
    
    
    
    # Set the material properties
    material.Type = IRobotMaterialType.I_MT_STEEL
    material.E = IN[10]*1000  # Young's modulus in Pascals
    material.NU = 0.33    # Poisson's ratio
    material.RO = IN[11]       # Unit weight in kg/m^3
    material.Kirchoff = material.E / (2 * (1 + material.NU))
    
    s=RobApp.Project.Structure.Labels.Store(a)
        
   
   
   
   
    indexes = sections
    indexes=[ 9.54203486, 15.   ,       2.23629054, 26.688612,    0.38552279, 10.73895709]
    
    
    column_sections = IN[5]
    beam_sections = IN[6]

    colum_indexes = indexes[:4]
    colum_indexes = [int(x) for x in colum_indexes]

    beams_indexes = indexes[4:]
    beams_indexes = [int(x) for x in beams_indexes]
    num_list = colum_indexes
    
    selected_columns = [column_sections[i] for i in colum_indexes]
    selected_beams = [beam_sections[i] for i in beams_indexes]
    J_list = selected_columns + selected_beams
    

    section_names = [J_list[0]] * 2 + [J_list[1]]+ [J_list[2]]*2+ [J_list[3]]+ [J_list[2]]*2+ [J_list[3]]+[J_list[0]]*2+ [J_list[1]]+[J_list[4]]*6+ [J_list[5]]*3
    
    # Assign each section from the list to the corresponding bar
    for i, section_name in enumerate(section_names, start=1):
        # Retrieve the bar using its index
        bar = RobApp.Project.Structure.Bars.Get(i)
        
        # Cast the bar to the IRobotBar type
        bar = IRobotBar(bar)
        
        # Set the section label to the bar
        bar.SetLabel(IRobotLabelType.I_LT_BAR_SECTION, section_name)
        bar.SetLabel(IRobotLabelType.I_LT_MATERIAL ,material_name  )
        bar.SetLabel(IRobotLabelType.I_LT_BAR_RELEASE ,"Fixed-Fixed")  
        
        
        
    a=RobApp.Project.get_CalcEngine()
    b=IRobotCalcEngine(a)
    b.Calculate()

    Save=RobApp.Kernel
    b=IRobotKernel(Save)
    b.ProjectSaveAs(r'C:\Users\ugury\OneDrive\Masaüstü\Test1.rtd')
    
    

else:
    print("The option is not selected")


sys.stdout.seek(0)
OUT = sys.stdout.read()

    
    
 
# ----------------------------------------
watch_2 = Watch(generate_and_analyse_on_rsa)
